# Grasshopper definition extractionPolyhedrefromOff.gh (Grasshopper 0.9.76)
# plug-ins: Python Interpreter

file = ReadFile(File="C:\Users\Francesco\Documents\GitHub\groupe des permutations\tetrakis_hexahedron.off", PerLineParse=True)
_3 = Integer(2)
_1 = Integer(1)
split = SplitList(List=file, Index=_3)  # -> ListA, ListB
split_2 = SplitList(List=split.ListB, Index=_1)  # -> ListA, ListB
# On jette
panel = Panel(split.ListA)
panel_2 = Panel(split_2.ListA)
txt = Text("\" \"")
split_3 = TextSplit(Text=panel_2, Separators=txt)
panel_3 = Panel(file)
int = Integer(1)
# Faces
item = ListItem(List=split_3, Index=1, Wrap=True)
# Arêtes
item_2 = ListItem(List=split_3, Index=2, Wrap=True)
# Sommets
item_3 = ListItem(List=split_3, Index=0, Wrap=True)
panel_4 = Panel(item_3)
nb_sommets = Integer(panel_4)
series = Series(Start=0, Step=1, Count=nb_sommets)
split_4 = SplitList(List=split_2.ListB, Index=nb_sommets)  # -> ListA, ListB
split_5 = SplitList(List=split_4.ListB, Index=item)  # -> ListA, ListB
item_4 = ListItem(List=split_4.ListA, Index=series, Wrap=True)
partition = PartitionList(List=split_5.ListA, Size=int)
partition_2 = PartitionList(List=item_4, Size=int)
python = PythonScript(x=partition)  # -> out, a
# ---------- python: Python ----------
import re


# Expression régulière pour les entiers et les décimaux (positifs ou négatifs)
pattern = r"-?\d+(?:\.\d+)?"

# Extraction de tous les réels sous forme de chaînes de caractères
reels_str = re.findall(pattern, x)

# Conversion en type float
a = [float(x) for x in reels_str]
# ---------- end python ----------
panel_5 = Panel(item)
panel_6 = Panel(item_2)
python_2 = PythonScript(x=partition_2)  # -> out, a; same code as python
split_6 = SplitList(List=python.a, Index=0)  # -> ListA, ListB
item_5 = ListItem(List=python_2.a, Index=2, Wrap=True)
item_6 = ListItem(List=python_2.a, Index=1, Wrap=True)
item_7 = ListItem(List=python_2.a, Index=0, Wrap=True)
# Les sommets
# La liste des sommets
pt = ConstructPoint(XCoordinate=item_7, YCoordinate=item_6, ZCoordinate=item_5)
flatten = FlattenTree(Tree=pt, Path="{0}")
panel_7 = Panel(python.a)
