# Grasshopper definition lireUnPolyedre.gh (Grasshopper 0.9.76)
# plug-ins: Python Interpreter

path = FilePath("C:\Users\Francesco\Documents\GitHub\groupe des permutations\tetrakis_hexahedron.off")
python = PythonScript()  # -> out, a
# ---------- python: Python ----------
import Rhino.Geometry as rg

# Define the 16 values row by row
m00, m01, m02, m03 = 1.0, 0.0, 0.0, 5.0   # Row 0
m10, m11, m12, m13 = 0.0, 1.0, 0.0, 10.0  # Row 1
m20, m21, m22, m23 = 0.0, 0.0, 1.0, 15.0  # Row 2
m30, m31, m32, m33 = 0.0, 0.0, 0.0, 1.0   # Row 3

# Initialize the Transform matrix

myMatrix = rg.Transform(
    [m00, m01, m02, m03,
    m10, m11, m12, m13,
    m20, m21, m22, m23,
    m30, m31, m32, m33]
)


# Output the matrix to Grasshopper
#a = myMatrix
a=m00
# ---------- end python ----------
python_2 = PythonScript(x=path)  # -> out, a
# ---------- python_2: Python ----------
import rhinoscriptsyntax as rs





fichier=open(x,'r')
les_lignes=fichier.readlines()
caracteristiques=les_lignes[2]
a=les_lignes[3:]
print(caracteristiques)
numbers = [int(x) for x in caracteristiques.split()]
sommets=numbers[0]
faces=numbers[1]
aretes=numbers[2]

liste_pro=a[0:sommets]
liste_sommets=[]
for u in liste_pro: 
 liste_sommets.append(map(float,u.split()))
 
print(liste_sommets)


liste_pro= a[sommets:sommets+faces]
liste_faces=[]
for u in liste_pro: 
 liste_faces.append(map(int,u.split())[1:])

 
liste_pro=a[sommets+faces:]
liste_aretes=[]
for u in liste_pro: 
 liste_aretes.append(map(int,u.split()))

"""
aretes=[]
for i in liste_aretes: 
   print(i)
   depart=liste_sommets[i[0]]
   arrivee=liste_sommets[i[1]]
   aretes.append(rs.AddLine(depart,arrivee))
a=aretes
"""
faces=[]
for i in liste_faces: 
 liste=[]
 if len(i)<5:
  for j in range(len(i)):
   liste.append(rs.AddPoint(liste_sommets[i[j]]))
  faces.append(rs.AddSrfPt(liste))
 else: # len(i)==5
  liste1=[liste_sommets[i[0]],liste_sommets[i[1]],liste_sommets[i[4]]]
  liste2=[liste_sommets[i[1]],liste_sommets[i[2]],liste_sommets[i[3]]]
  liste3=[liste_sommets[i[1]],liste_sommets[i[3]],liste_sommets[i[4]]]
  faces.append(rs.AddSrfPt(liste1))
  faces.append(rs.AddSrfPt(liste2))
  faces.append(rs.AddSrfPt(liste3))
  
a=faces


  
""" 
for u in liste_aretes: 
    print(u)

liste_pro=[]
for u in liste_sommets: 
 print(u)
 liste_pro.append(rs.AddPoint(u[0],u[1],u[2]))
a=liste_pro
"""
# ---------- end python_2 ----------
srf = Surface(python_2.a)
panel = Panel(python_2.out)
panel_2 = Panel(python_2.a)
