# Grasshopper definition polyRhino.gh (Grasshopper 0.9.76)

txt = Text("\"C:/Users/Francesco/Documents/Github/groupe%20des%20permutations/tetrakis_hexaedron.off\"")
file = ReadFile(File=txt, PerLineParse=True)
file_2 = ReadFile(File=file, PerLineParse=True)
c_script = CSharpScript()  # -> out, A; inputs x: list of Point3d
# ---------- c_script: C# ----------
    Mesh m = new Mesh();

    m.Vertices.AddVertices(x);

    // Example for a single triangular face connecting the first 3 points
    m.Faces.AddFace(0, 1, 2);

    // Example for a quad face connecting the first 4 points
    // m.Faces.AddFace(0, 1, 2, 3);

    A = m;
# ---------- end c_script ----------
split = TextSplit(Text=file_2)
