# Grasshopper definition transfosurunpolyhedre.gh (Grasshopper 0.9.76)
# plug-ins: LunchBox

num = Number(2)
pt = ConstructPoint(XCoordinate=0, YCoordinate=0, ZCoordinate=0)
pt_2 = ConstructPoint(XCoordinate=0, YCoordinate=Slider(0.828, range=0..1), ZCoordinate=0)
platododec = PlatonicDodecahedron(Plane=PlaneXY(0, 0, 0), Radius=10)
geo = Geometry(<brep referenced from the Rhino model>)
vec2pt = Vector2Pt(PointA=pt, PointB=pt_2, Unitize=False)  # -> Vector, Length
vec = VectorXYZ(XComponent=0, YComponent=0, ZComponent=0)  # -> Vector, Length
division = Division(A=vec2pt.Vector, B=2)
scale = Scale(Geometry=geo, Center=Point(0, 0, 0), Factor=Slider(2.839, range=0..10))  # -> Geometry, Transform
extr = Extrude(Base=scale.Geometry, Direction=vec2pt.Vector)
neg = Negative(Value=division)
move = Move(Motion=vec.Vector)  # -> Geometry, Transform
vec_2 = VectorXYZ(XComponent=0, YComponent=0, ZComponent=0)  # -> Vector, Length
move_2 = Move(Geometry=scale.Geometry, Motion=neg)  # -> Geometry, Transform
brep = Brep(platododec)
int = Integer(1)
move_3 = Move(Motion=vec_2.Vector)  # -> Geometry, Transform
scale_2 = Scale(Geometry=brep, Center=Point(0, 0, 0), Factor=Slider(1.421, range=0..10))  # -> Geometry, Transform
pt_3 = ConstructPoint(XCoordinate=0, YCoordinate=0, ZCoordinate=0)
pt_4 = ConstructPoint(XCoordinate=0, YCoordinate=int, ZCoordinate=0)
debrep = DeconstructBrep(Brep=scale_2.Geometry)  # -> Faces, Edges, Vertices
pt_5 = ConstructPoint(XCoordinate=0, YCoordinate=0, ZCoordinate=int)
pt_6 = ConstructPoint(XCoordinate=int, YCoordinate=0, ZCoordinate=0)
number_slider = Slider(0, range=0..80)
number_slider_2 = Slider(0, range=0..6.283)
pt_7 = ConstructPoint(XCoordinate=0, YCoordinate=0, ZCoordinate=0)
pt_8 = ConstructPoint(XCoordinate=0, YCoordinate=0, ZCoordinate=0)
c_script = CSharpScript(x=debrep.Vertices)  # -> out, A, nbLengths, B; inputs x: list of Point3d
# ---------- c_script: C# ----------
    Hashtable lesListes = new Hashtable();
    int n = x.Count();
    for (int i = 0; i < n; i++){
      Point3d p1 = x[i];
      for(int j = i + 1;j < n;j++){
        Point3d p2 = x[j];
        Double dist = Math.Round(p1.DistanceTo(p2), 6);
        if(!lesListes.ContainsKey(dist))
        {
          RhinoList<Line> newListe = new RhinoList<Line>();
          newListe.Add(new Line(p1, p2));
          lesListes.Add(dist, newListe);
        }
        else{
          RhinoList<Line> listeCourante = (RhinoList<Line>) lesListes[dist];
          listeCourante.Add(new Line(p1, p2));
        }

      }


    }

    ArrayList arrayList = new ArrayList(lesListes.Keys);
    arrayList.Sort();
    //RhinoList < RhinoList < Line >> superCollec = new  RhinoList < RhinoList < Line >> ();
    DataTree<Line> myTree = new DataTree<Line>();
    //int k = 0;
    for( int k = 0;k < arrayList.Count;k++ )
    {
      GH_Path pth = new GH_Path(k);
      RhinoList<Line> collec = (RhinoList<Line>) lesListes[arrayList[k]];
      foreach(Line val in collec){
        //superCollec.Add(collec);

        myTree.Add(val, pth);
      }
    }

    A = myTree;
    B = arrayList;
    nbLengths = arrayList.Count;
# ---------- end c_script ----------
item = ListItem(List=c_script.B, Index=number_slider, Wrap=True)
ln = Line(StartPoint=pt_3, EndPoint=pt_5)
rotax = RotateAxis(Geometry=move.Geometry, Angle=number_slider_2, Axis=ln)  # -> Geometry, Transform
rotax_2 = RotateAxis(Geometry=move_3.Geometry, Angle=number_slider_2, Axis=ln)  # -> Geometry, Transform
ln_2 = Line(StartPoint=pt_8, EndPoint=pt_4)
ln_3 = Line(StartPoint=pt_7, EndPoint=pt_6)
panel = Panel(c_script.B)
number_slider_3 = Slider(0.834, range=0..6.283)
rotax_3 = RotateAxis(Geometry=move_2.Geometry, Angle=number_slider_2, Axis=ln)  # -> Geometry, Transform
rotax_4 = RotateAxis(Geometry=rotax.Geometry, Angle=number_slider_3, Axis=ln_2)  # -> Geometry, Transform
panel_2 = Panel("Oz")
branch = TreeBranch(Tree=c_script.A, Path=number_slider, MaintainPaths=True)
panel_3 = Panel(c_script.nbLengths)
rotax_5 = RotateAxis(Geometry=rotax_2.Geometry, Angle=number_slider_3, Axis=ln_2)  # -> Geometry, Transform
viewer = ParamViewer(c_script.A)
line = Line(branch)
number_slider_4 = Slider(0, range=0..6.283)
number_slider_5 = Slider(4, range=0..29)
rotax_6 = RotateAxis(Geometry=rotax_4.Geometry, Angle=number_slider_4, Axis=ln_3)  # -> Geometry, Transform
rotax_7 = RotateAxis(Geometry=rotax_5.Geometry, Angle=number_slider_4, Axis=ln_3)  # -> Geometry, Transform
end = EndPoints(Curve=line)  # -> Start, End
rotax_8 = RotateAxis(Geometry=rotax_3.Geometry, Angle=number_slider_3, Axis=ln_2)  # -> Geometry, Transform
panel_4 = Panel("Oy")
rotax_9 = RotateAxis(Geometry=rotax_8.Geometry, Angle=number_slider_4, Axis=ln_3)  # -> Geometry, Transform
panel_5 = Panel("Ox")
pt_9 = ConstructPoint(XCoordinate=Slider(0.338, range=0..1), YCoordinate=Slider(1, range=0..1), ZCoordinate=Slider(0.009, range=0..1))
c_script_2 = CSharpScript(PointA=end.Start, PointB=end.End)  # -> out, victor, issue; inputs PointA: Point3d, PointB: Point3d
# ---------- c_script_2: C# ----------
    Vector3d vecteurA = new Vector3d(PointA);
    Vector3d vecteurB = new Vector3d(PointB);
    Point3d middle = Point3d.Multiply(Point3d.Add(PointA, PointB), 0.5);
    Vector3d direction = new Vector3d(middle);

    Vector3d vAc = vecteurA - direction;
    Vector3d vBc = vecteurB - direction;

    Double ang = 0;
    Double bng = 0;
    direction.Unitize();
    if(vAc.X == 0){
      if(vAc.Y == 0){
        ang = 0;
        bng = 0;
      }
      else{
        if(vAc.Y < 0)
          ang = Math.PI / 2;
        else
          ang = -Math.PI / 2;
      }
    }
    else{
      ang = -Math.Atan2(vAc.Y, vAc.X);
    }

    // rotation par rapport a 0Z
    Transform rotz = Transform.Rotation(ang, new Vector3d(0, 0, 1), new Point3d(0, 0, 0));
    Vector3d newDir = new Vector3d(vAc);
    newDir.Transform(rotz);
    Double longueur = Math.Sqrt(newDir.X * newDir.X + newDir.Z * newDir.Z);
    if(longueur != 0)
      bng = Math.Atan2(newDir.Z, newDir.X);
    Transform roty = Transform.Rotation(bng, new Vector3d(0, 1, 0), new Point3d(0, 0, 0));
    newDir.Transform(roty);
    Transform rotfinal = roty * rotz;
    vAc.Transform(rotfinal);
    direction.Transform(rotfinal);
    Double angle3 = Math.Atan2(direction.Y, direction.Z);
    Transform rotx = Transform.Rotation(angle3, new Vector3d(1, 0, 0), new Point3d(0, 0, 0));
    rotfinal = rotx * roty * rotz;
    Transform bonSens = roty;
    rotfinal.TryGetInverse(out bonSens);
    Transform decal = Transform.Translation(new Vector3d(middle));
    Transform finale = decal * bonSens;



    //Transform rot = Transform.Rotation(direction, vecteurA, middle);
    //Transform roto =rot* Transform.Translation(new Vector3d(middle));
    victor = finale;
    issue = direction;
# ---------- end c_script_2 ----------
transform = Transform(Geometry=rotax_6.Geometry, Transform=c_script_2.victor)
transform_2 = Transform(Geometry=rotax_7.Geometry, Transform=c_script_2.victor)
item_2 = ListItem(List=c_script_2.issue, Index=number_slider_5, Wrap=True)
item_3 = ListItem(List=c_script_2.victor, Index=number_slider_5, Wrap=True)
transform_3 = Transform(Geometry=pt_9, Transform=c_script_2.victor)
transform_4 = Transform(Geometry=rotax_9.Geometry, Transform=c_script_2.victor)
pdecon = Deconstruct(Point=transform_3)  # -> XComponent, YComponent, ZComponent
panel_6 = Panel(item_3)
panel_7 = Panel(item_2)
group = Group(Objects=[transform, transform_2, transform_4])  # disabled
xyz = ColourXYZ(Alpha=1, X=pdecon.XComponent, Y=pdecon.YComponent, Z=pdecon.ZComponent)
matrix = DisplayMatrix(item_3)
preview = CustomPreview(Geometry=transform_4, Shader=xyz)
